# Grasshopper definition gh_setup.gh (Grasshopper 1.0.8)

assignment01 = FilePath("C:\Users\david\Desktop\MPDA\repos\MPDA25-Session04\qodo\assignment01.py")
make_sure_is_the_right_path = Panel(assignment01)
file = ReadFile(File=assignment01, PerLineParse=False)
py3 = Python3Script(script=file, x_points=Slider(10, range=0..10), y_points=Slider(10, range=0..10))  # -> out, a, b, c, d, e, f, g, h; inputs x_points: Int32, y_points: Int32; unedited script template
